# Grasshopper definition assert-misc-examples.gh (Grasshopper 1.0.8)
# plug-ins: Assertive Possum

# Assert Misc
# Other miscellaneous asserts
test_name = Panel("assert-contains-example")
list = Panel("""a
b
c
d""")
item = Panel("c")
test_name_2 = Panel("assert-list-lenght-example")
list_2 = Panel("""a
b
c
d""")
expected_list_length = Slider(4, range=0..10)
test_name_3 = Panel("assert-in-range-example")
maximum = Slider(10, range=0..10)
actual_value = Slider(7, range=0..10)
minimum = Slider(0, range=0..10)
# * 7 is greater than 0 and
#   less than 10, so this test
#   should succeed
arng = AssertInRange(Name=test_name_3, Value=actual_value, Min=minimum, Max=maximum)
# * this list is 4 items long,
#   so the test should succeed
alen = AssertListLength(Name=test_name_2, List=list_2, Length=expected_list_length)
# * item is in the list,
#   so this test should succeed
acnt = AssertContains(Name=test_name, List=list, Item=item)
test_result_to_json = TestResultToJSON(Result=acnt)
test_result_to_json_2 = TestResultToJSON(Result=alen)
test_result_to_json_3 = TestResultToJSON(Result=arng)
# * uniquely named Hops / Rhino.Compute output
context_print = ContextPrint(AssertContainsExample=test_result_to_json)
# * uniquely named Hops / Rhino.Compute output
context_print_2 = ContextPrint(AssertListLenghtExample=test_result_to_json_2)
# * uniquely named Hops / Rhino.Compute output
context_print_3 = ContextPrint(AssertInRangeExample=test_result_to_json_3)
